# Grasshopper definition Analysis for Modular Construction.gh (Grasshopper 1.0.8)
# plug-ins: PollinationGH

epwmap = LBEPWmap(epw_map=Toggle(True))  # -> Output; plug-in component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
file_path = FilePath("\\?\D:\00_Personal Documents\1_Learning\TECH\6_ Courses Archived\ARCH_8833 - Data-driven Mtds for Design & Sustainability (3)\5_Assignments\Final Project\Energy Simulation\USA_GA_Fulton.County.AP-Brown.Field.722195_TMY3\USA_GA_Fulton.County.AP-Brown.Field.722195_TMY3.epw")
brep = Brep(<brep referenced from the Rhino model>)
importepw = LBImportEPW(epw_file=file_path)  # -> location, dry_bulb_temperature, dew_point_temperature, relative_humidity, wind_speed, wind_direction, direct_normal_rad, diffuse_horizontal_rad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; plug-in component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
brep_2 = Brep([<brep referenced from the Rhino model> x3])
face = HBFace(geo=brep)  # -> out, faces; plug-in component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
brep_3 = Brep(<brep referenced from the Rhino model>)
deconstruct_brep = DeconstructBrep(Brep=brep_2)  # -> Faces, Edges, Vertices
deconstruct_brep_2 = DeconstructBrep(Brep=brep_3)  # -> Faces, Edges, Vertices
surface = Surface(<surface referenced from the Rhino model>)
surface_2 = Surface([<surface referenced from the Rhino model> x2])
number_slider = Slider(0, range=0..1)
aperture = HBAperture(geo=surface_2)  # -> out, apertures; plug-in component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
door = HBDoor(geo=surface)  # -> out, doors; plug-in component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
room = HBRoom(faces=flatten(face.faces), name="mod01", conditioned=True)  # -> out, room; plug-in component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
list_item = ListItem(List=deconstruct_brep.Faces, Index=Slider(0, range=0..5), Wrap=True)
list_item_2 = ListItem(List=deconstruct_brep_2.Faces, Index=Slider(0, range=0..5), Wrap=True)
panel = Panel(deconstruct_brep_2.Faces)
check_study_status = CheckStudyStatus(
    _study="ladybug-tools/NREL Building/cd7c6e49-95a6-43a6-be43-62987b95e6a6",
    Run_index_=0,
    LiveUpdateStatus=True,
    getBothInputOutputAssets=False)  # -> Status, Finished_run
series = Series(Start=number_slider, Step=number_slider, Count=Slider(23, range=0..100))
series_2 = Series(Start=Slider(1, range=0..1), Step=Slider(1, range=0..1), Count=Slider(30, range=0..100))
series_3 = Series(Start=Slider(1, range=0..1), Step=Slider(1, range=0..1), Count=Slider(12, range=0..100))
model = HBModel(rooms=flatten(room.room), apertures=flatten(aperture.apertures), doors=flatten(door.doors))  # -> out, model; plug-in component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
mesh_surface = MeshSurface(
    Surface=deconstruct_brep.Faces,
    UCount=Slider(1, range=0..100),
    VCount=Slider(1, range=0..100),
    Overhang=True,
    Equalize=False)
mesh_surface_2 = MeshSurface(
    Surface=deconstruct_brep_2.Faces,
    UCount=Slider(20, range=0..100),
    VCount=Slider(20, range=0..100),
    Overhang=True,
    Equalize=False)
hoy = LBCalculateHOY(month=series_3, day=series_2, hour=series)  # -> flatten(hoy), flatten(doy), flatten(date); plug-in component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
check_run_results = CheckRunResults(
    _run=check_study_status.Finished_run,
    recipeSource="https://api.pollination.solutions/registries/ladybug-tools/recipe/annual-daylight/0.8.12-viz")  # -> CDA, DA, Metrics, Results, Results_direct, UDI, UDI_low, UDI_up, Visualization
panel_2 = Panel(check_study_status.Finished_run)
mesh_join = MeshJoin(Meshes=mesh_surface)
mesh_join_2 = MeshJoin(Meshes=mesh_surface_2)
vizbytype = HBVisualizeByType(hb_objs=model.model)  # -> walls, interior_walls, roofs, ceilings, exterior_floors, interior_floors, air_walls, apertures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; plug-in component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
skymatrix = LBCumulativeSkyMatrix(
    location=importepw.location,
    direct_rad=importepw.direct_normal_rad,
    diffuse_rad=importepw.diffuse_horizontal_rad,
    high_density=Toggle(True))  # -> out, sky_mtx; plug-in component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
panel_3 = Panel("C:\ladybugs\demo")
load_assets = LoadAssets(
    Folder_=check_run_results.Results,
    Asset_1=model.model,
    LiveUpdateStatus=True,
    postprocessWithHandler=True,
    useCachedAssets=True)  # -> Logs, Value_1, Value_2, Value_3
mesh = Mesh(vizbytype.doors)
loadobjects = HBLoadObjects(hb_file=load_assets.Value_1, load=Toggle(False))  # -> out, hb_objs; plug-in component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
incidentradiation = LBIncidentRadiation(
    sky_mtx=skymatrix.sky_mtx,
    geometry=flatten(mesh_join_2),
    context=flatten(mesh_join),
    grid_size=Slider(0.05, range=0..0.1),
    run=Toggle(True))  # -> out, points, results, total, mesh, legend, title, int_mtx; plug-in component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
panel_4 = Panel(Toggle(True))
panel_5 = Panel("https://energyplus-weather.s3.amazonaws.com/north_and_central_america_wmo_region_4/USA/GA/USA_GA_Atlanta.722190_TMY2/USA_GA_Atlanta.722190_TMY2.zip")
getgridsviews = HBGetGridsAndViews(model=loadobjects.hb_objs)  # -> views, grids, points, meshes; plug-in component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
vizall = HBVisualizeAll(hb_objs=flatten(loadobjects.out))  # -> geo; plug-in component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
epwmap_2 = LBEPWmap(epw_map=panel_4)  # -> Output; plug-in component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
downloadepw = LBDownloadWeather(weather_URL=panel_5)  # -> epw_file, stat_file, ddy_file; plug-in component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
data = Data(incidentradiation.total)
boolean_toggle = BooleanToggle(True)
panel_6 = Panel(data)
integer = Integer()
annualloads = HBAnnualLoads(rooms=flatten(room.room), epw_file=downloadepw.epw_file, run=Toggle(True))  # -> out, total_load, cooling, heating, lighting, equip, process, hot_water, balance; plug-in component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
peakloads = HBPeakLoads(timestep=integer, run_bal=boolean_toggle, run=boolean_toggle)  # -> out, peak_cool, peak_heat, cooling, heating, cool_bal, heat_bal; plug-in component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
quick_graph = QuickGraph(panel_6, SortOrder=0)
panel_7 = Panel(annualloads.total_load)
